vi "DEC_split.gvi"   [LabVIEW Conversion 5.2.0.58310]
inputs:
  "Input DEC array": f32[][]
outputs:
  "delta time": u32[]
  "Timepoint": f64[]
  "TTL input 2": f32[]
  "X1": f32[]
  "Y1": f32[]
  "X2": f32[]
  "Y2": f32[]
  "ms since ON": u32[]
  "Channel": u32[]
  "TTL input 1": f32[]
diagram:
  Array Index(array=$"Input DEC array") -> (out0[_, 0]=w1)
  To Unsigned Long Integer(number=w1) -> w2
  $"ms since ON" <- w2
  Array Index(array=$"Input DEC array") -> (out0[_, 1]=w3)
  To Unsigned Long Integer(number=w3) -> w4
  $"delta time" <- w4
  Array Index(array=$"Input DEC array") -> (out0[_, 2]=w5)
  To Unsigned Long Integer(number=w5) -> w6
  $Channel <- w6
  Array Index(array=$"Input DEC array") -> (out0[_, 3]=w7)
  $X1 <- w7
  Array Index(array=$"Input DEC array") -> (out0[_, 4]=w8)
  $Y1 <- w8
  Array Index(array=$"Input DEC array") -> (out0[_, 5]=w9)
  $X2 <- w9
  Array Index(array=$"Input DEC array") -> (out0[_, 6]=w10)
  $Y2 <- w10
  Array Index(array=$"Input DEC array") -> (out0[_, 7]=w11)
  $"TTL input 1" <- w11
  Array Index(array=$"Input DEC array") -> (out0[_, 8]=w12)
  $"TTL input 2" <- w12
  Array Index(array=$"Input DEC array") -> (out0[_, 9]=w13)
  $Timepoint <- w13
