vi "Decode_RAW_to_DEC.gvi"   [LabVIEW Conversion 5.2.0.58310]
inputs:
  "read buffer": string
  "Read TTL status": bool
outputs:
  "DEC SGL output": f32[][]
panel indicators:
  "transposed array": f32[][]
diagram:
  case ($"Read TTL status") {
    frame False, Default {
      while {
        Feedback Node(input=w12) -> w13
        Search And Replace String(input string=$"read buffer", offset (0)=w13, replace all (F)=FALSE, replace string ("")="FEFE", search string="FEFE") -> (offset past replacement=w12, result string=w14)
        Is Less(x=w12, y=0) -> w15
        Subtract(x=w12, y=52) -> w16
        case (w15) {
          frame False, Default {
            String Subset(length (rest)=8, offset (0)=w16, string=w14) -> w26
            Hexadecimal String To Number(default (0 U32)=0, string=w26) -> (number=w17)
            Add(w16, 8) -> w27
            String Subset(length (rest)=4, offset (0)=w27, string=w14) -> w28
            Hexadecimal String To Number(default (0 U32)=0, string=w28) -> (number=w18)
            Add(w27, 4) -> w29
            String Subset(length (rest)=4, offset (0)=w29, string=w14) -> w30
            Hexadecimal String To Number(default (0 U32)=0, string=w30) -> (number=w19)
            Add(w29, 4) -> w31
            String Subset(length (rest)=8, offset (0)=w31, string=w14) -> w32
            Hexadecimal String To Number(default (0 U32)=0, string=w32) -> (number=w33)
            Swap Words(data=w33) -> (word swapped=w34)
            Swap Bytes(data=w34) -> (byte swapped=w35)
            w36 = f32 0  # SGL
            Type Cast(type=w36, x=w35) -> w37
            Multiply(w37, 25) -> w38
            Subtract(x=w38, y=137.5) -> w20
            Add(w31, 8) -> w39
            String Subset(length (rest)=8, offset (0)=w39, string=w14) -> w40
            Hexadecimal String To Number(default (0 U32)=0, string=w40) -> (number=w41)
            Swap Words(data=w41) -> (word swapped=w42)
            Swap Bytes(data=w42) -> (byte swapped=w43)
            w44 = f32 0  # SGL
            Type Cast(type=w44, x=w43) -> w45
            Multiply(w45, 25) -> w46
            Subtract(x=w46, y=125) -> w21
            Add(w39, 8) -> w47
            String Subset(length (rest)=8, offset (0)=w47, string=w14) -> w48
            Hexadecimal String To Number(default (0 U32)=0, string=w48) -> (number=w49)
            Swap Words(data=w49) -> (word swapped=w50)
            Swap Bytes(data=w50) -> (byte swapped=w51)
            w52 = f32 0  # SGL
            Type Cast(type=w52, x=w51) -> w53
            Multiply(w53, 25) -> w54
            Subtract(x=w54, y=137.5) -> w22
            Add(w47, 8) -> w55
            String Subset(length (rest)=8, offset (0)=w55, string=w14) -> w56
            Hexadecimal String To Number(default (0 U32)=0, string=w56) -> (number=w57)
            Swap Words(data=w57) -> (word swapped=w58)
            Swap Bytes(data=w58) -> (byte swapped=w59)
            w60 = f32 0  # SGL
            Type Cast(type=w60, x=w59) -> w61
            Multiply(w61, 25) -> w62
            Subtract(x=w62, y=125) -> w23
            Add(w55, 8) -> w63
            String Subset(length (rest)=4, offset (0)=w63, string=w14) -> w64
            Hexadecimal String To Number(default (0 U32)=0, string=w64) -> (number=w24)
            w25 = -1000
          }
          frame True {
            w17 = -1000
            w18 = -1000
            w19 = -1000
            w20 = -1000
            w21 = -1000
            w22 = -1000
            w23 = -1000
            w24 = -1000
            w25 = -1000
          }
        }
        Feedback Node(input=w65) -> w66
        Search And Replace String(input string=$"read buffer", offset (0)=w66, replace all (F)=FALSE, replace string ("")="FFFF", search string="FFFF") -> (offset past replacement=w65)
        Subtract(x=w16, y=w65) -> w67
        append w17 to w7
        append w18 to w6
        append w19 to w5
        append w20 to w4
        append w21 to w3
        append w22 to w2
        append w23 to w1
        append w24 to w8
        append w67 to w9
        append w25 to w10
        stop if w15
      }
      w11 = w10
    }
    frame True {
      while {
        Feedback Node(input=w68) -> w69
        Search And Replace String(input string=$"read buffer", offset (0)=w69, replace all (F)=FALSE, replace string ("")="FEFE", search string="FEFE") -> (offset past replacement=w68, result string=w70)
        Is Less(x=w68, y=0) -> w71
        Subtract(x=w68, y=60) -> w72
        case (w71) {
          frame False, Default {
            String Subset(length (rest)=8, offset (0)=w72, string=w70) -> w83
            Hexadecimal String To Number(default (0 U32)=0, string=w83) -> (number=w73)
            Add(w72, 8) -> w84
            String Subset(length (rest)=4, offset (0)=w84, string=w70) -> w85
            Hexadecimal String To Number(default (0 U32)=0, string=w85) -> (number=w74)
            Add(w84, 4) -> w86
            String Subset(length (rest)=4, offset (0)=w86, string=w70) -> w87
            Hexadecimal String To Number(default (0 U32)=0, string=w87) -> (number=w75)
            Add(w86, 4) -> w88
            String Subset(length (rest)=8, offset (0)=w88, string=w70) -> w89
            Hexadecimal String To Number(default (0 U32)=0, string=w89) -> (number=w90)
            Swap Words(data=w90) -> (word swapped=w91)
            Swap Bytes(data=w91) -> (byte swapped=w92)
            w93 = f32 0  # SGL
            Type Cast(type=w93, x=w92) -> w94
            w95 = 25  # Sensors grid step
            Multiply(w94, w95) -> w96
            w97 = 137.5  # Half-width of the sensor board
            Subtract(x=w96, y=w97) -> w76
            Add(w88, 8) -> w98
            String Subset(length (rest)=8, offset (0)=w98, string=w70) -> w99
            Hexadecimal String To Number(default (0 U32)=0, string=w99) -> (number=w100)
            Swap Words(data=w100) -> (word swapped=w101)
            Swap Bytes(data=w101) -> (byte swapped=w102)
            w103 = f32 0  # SGL
            Type Cast(type=w103, x=w102) -> w104
            Multiply(w104, w95) -> w105
            w106 = 125  # Half-height of the sensor board
            Subtract(x=w105, y=w106) -> w77
            Add(w98, 8) -> w107
            String Subset(length (rest)=8, offset (0)=w107, string=w70) -> w108
            Hexadecimal String To Number(default (0 U32)=0, string=w108) -> (number=w109)
            Swap Words(data=w109) -> (word swapped=w110)
            Swap Bytes(data=w110) -> (byte swapped=w111)
            w112 = f32 0  # SGL
            Type Cast(type=w112, x=w111) -> w113
            Multiply(w113, w95) -> w114
            Subtract(x=w114, y=w97) -> w78
            Add(w107, 8) -> w115
            String Subset(length (rest)=8, offset (0)=w115, string=w70) -> w116
            Hexadecimal String To Number(default (0 U32)=0, string=w116) -> (number=w117)
            Swap Words(data=w117) -> (word swapped=w118)
            Swap Bytes(data=w118) -> (byte swapped=w119)
            w120 = f32 0  # SGL
            Type Cast(type=w120, x=w119) -> w121
            Multiply(w121, w95) -> w122
            Subtract(x=w122, y=w106) -> w79
            Add(w115, 8, 4) -> w123
            Add(w123, 2) -> w124
            String Subset(length (rest)=2, offset (0)=w124, string=w70) -> w125
            Hexadecimal String To Number(default (0 U32)=0, string=w125) -> (number=w126)
            Quotient And Remainder(x=w126, y=4) -> (floor(x/y)=w127)
            Number To Boolean Array(number=w127) -> (Boolean array=w128)
            Array Index(array=w128) -> (out0[0]=w129)
            Boolean To Integer(Boolean=w129) -> (0, 1=w81)
            Array Index(array=w128) -> (out0[1]=w130)
            Boolean To Integer(Boolean=w130) -> (0, 1=w82)
            Add(w124, 2) -> w131
            String Subset(length (rest)=4, offset (0)=w131, string=w70) -> w132
            Hexadecimal String To Number(default (0 U32)=0, string=w132) -> (number=w80)
          }
          frame True {
            w73 = -2000
            w74 = -2000
            w75 = -2000
            w76 = -2000
            w77 = -2000
            w78 = -2000
            w79 = -2000
            w80 = -2000
            w81 = -2000
            w82 = -2000
          }
        }
        Feedback Node(input=w133) -> w134
        Search And Replace String(input string=$"read buffer", offset (0)=w134, replace all (F)=FALSE, replace string ("")="FFFF", search string="FFFF") -> (offset past replacement=w133)
        Subtract(x=w72, y=w133) -> w135
        append w73 to w7
        append w74 to w6
        append w75 to w5
        append w76 to w4
        append w77 to w3
        append w78 to w2
        append w79 to w1
        append w80 to w8
        append w135 to w9
        append w82 to w10
        append w81 to w11
        stop if w71
      }
    }
  }
  Build Array(w7, w6, w5, w4, w3, w2, w1, w11, w10, w9, w8) -> w136  # DEC output
  Transpose 2D Array(2D array=w136) -> (transposed array=w137)
  $"transposed array" <- w137
  Array Size(array=w137) -> (size(s)=w138)
  Array Index(array=w138) -> (out0[1]=w139)
  Decrement(x=w139) -> w140
  Array Index(array=w138) -> (out0[0]=w141)
  Decrement(x=w141) -> w142
  Delete From Array(inArray=w137, length (1)=1, index0=w142) -> w143
  Delete From Array(inArray=w143, length (1)=1, index1=w140) -> w144
  $"DEC SGL output" <- w144
