vi "HW_Setup.gvi"   [LabVIEW NXG 2.0.0]
inputs:
  "VISA resource name in": "Instr" = "Tracker"
outputs:
  "VISA resource name out": "Instr"
  "Data acquisition status (Acq. OFF)": Notifier<string>
  "Play/Pause status (Pause)": Notifier<string>
  "Error out": error
diagram:
  call "Tracker_hardware_initialize.gvi"(VISA resource name=$"VISA resource name in") -> (VISA resource name out=w1, error out=w2)
  Obtain Notifier(element data type=string "", error in=w2, name="Data acquisition status") -> (error out=w3, notifier out=w4)
  Send Notification(error in (no error)=w3, notification="Acq. OFF", notifier=w4) -> (error out=w5, notifier out=w6)
  $"Data acquisition status (Acq. OFF)" <- w6
  Obtain Notifier(element data type=string "", error in=w5, name="Play/Pause status") -> (error out=w7, notifier out=w8)
  Send Notification(error in (no error)=w7, notification="Pause", notifier=w8) -> (error out=w9, notifier out=w10)
  $"Play/Pause status (Pause)" <- w10
  $"Error out" <- w9
  $"VISA resource name out" <- w1
