vi "Stop_acquisition_amd_close_VISA.gvi"   [LabVIEW NXG 2.0.0]
inputs:
  "VISA resource name in": "Instr"
  "error in": error
  "Acquisition status in": Notifier<string>
  "Play/Pause status in": Notifier<string>
outputs:
  "error out": error
  "Acquisition status out": Notifier<string>
  "Play/Pause status out": Notifier<string>
uses:
  NI::VISA::Flush Buffer (Instr).gvi
  NI::VISA::Write (Instr, String).gvi
  NI::G Core::Error::Multiplex Errors.gvi
  NI::VISA::Clear (Instr).gvi
  NI::VISA::Close (Instr).gvi
diagram:
  sequence {
    frame 0 {
      call "Flush Buffer (Instr).gvi"(session in=$"VISA resource name in", error in=$"error in", mode="Discard Transmit Buffer"(128)) -> (session out=w1, error out=w2)
    }
    frame 1 {
      Concatenate Strings("T", "\r") -> w3
      call "Write (Instr, String).gvi"(session in=w1, write buffer=w3) -> (session out=w4, error out=w5)
      call "Multiplex Errors.gvi"(error in 1=w5, error in 2=w2) -> (error out=w6)
    }
    frame 2 {
      Wait(time to wait=250)
    }
    frame 3 {
      Concatenate Strings("REBOOT", "\r") -> w7
      call "Write (Instr, String).gvi"(session in=w4, error in=w6, write buffer=w7) -> (session out=w8, error out=w9)
    }
    frame 4 {
      Wait(time to wait=1000)
    }
    frame 5 {
      call "Clear (Instr).gvi"(session in=w8, error in=w9) -> (session out=w10, error out=w11)
    }
    frame 6 {
      call "Close (Instr).gvi"(session in=w10, error in=w11) -> (error out=w12)
    }
    frame 7 {
      Send Notification(notification="Pause", notifier=$"Play/Pause status in") -> (error out=w13, notifier out=w14)
      Send Notification(notification="Acq. OFF", notifier=$"Acquisition status in") -> (error out=w15, notifier out=w16)
      call "Multiplex Errors.gvi"(error in 1=w12, error in 2=w15, error in 3=w13) -> (error out=w17)
    }
  }
  $"Play/Pause status out" <- w14
  $"Acquisition status out" <- w16
  $"error out" <- w17
