vi "Stream_raw_data.gvi"   [LabVIEW NXG 2.0.0]
inputs:
  "Acquisition status in": Notifier<string>
  "Play/pause status is": Notifier<string>
  "VISA resource name in": "Instr"
  "error in (no error)": error
outputs:
  "Acquisition status out": Notifier<string>
  "error out": error
  "Play/pause status out": Notifier<string>
  "VISA Refnum out": "Instr"
  "Current time": timestamp
  "read buffer": string
uses:
  NI::G Core::Error::Multiplex Errors.gvi
  NI::VISA::Write (Instr, String).gvi
  NI::VISA::Flush Buffer (Instr).gvi
  NI::VISA::Read (Instr, Bytes).gvi
  NI::G Core::Error::Filter Error Code.gvi
  NI::VISA::Clear (Instr).gvi
diagram:
  Get Notifier Status(error in (no error)=$"error in (no error)", notifier=$"Play/pause status is") -> (error out=w1, latest notification=w2, notifier out=w3)
  Get Notifier Status(error in (no error)=$"error in (no error)", notifier=$"Acquisition status in") -> (error out=w4, latest notification=w5, notifier out=w6)
  call "Multiplex Errors.gvi"(error in 1=w1, error in 2=w4) -> (error out=w7)
  case (w2) {
    frame "Pause", Default {
      case (w5) {
        frame "Acq. OFF", Default {
          w8 = w7
          w9 = $"VISA resource name in"
          w10 = w6
        }
        frame "Acq. ON" {
          sequence {
            frame 0 {
              call "Write (Instr, String).gvi"(session in=$"VISA resource name in", error in=w7, write buffer="T") -> (session out=w13, error out=w14)
            }
            frame 1 {
              Wait(time to wait=100)
              Send Notification(error in (no error)=w14, notification="Acq. OFF", notifier=w6) -> (error out=w15, notifier out=w10)
            }
            frame 2 {
              call "Flush Buffer (Instr).gvi"(session in=w13, error in=w15, mode="Discard Receive Buffer"(64)) -> (session out=w9, error out=w8)
            }
          }
        }
      }
      w11 = w3
      w12 = default
    }
    frame "Play" {
      Get Current Time() -> (current time=w12)
      case (w5) {
        frame "Acq. ON", Default {
          Wait Until Next Multiple(multiple to wait=10)
          Property Node(instance in=$"VISA resource name in", error in=w7) -> ("ASRL Bytes at Port"=w16, error out=w17, instance out=w18)
          call "Read (Instr, Bytes).gvi"(session in=w18, error in=w17, byte count=w16) -> (session out=w9, error out=w19, read buffer=w20)
          Number To Hexadecimal String(number=w20, width (-)=2) -> (hex integer string=w21)
          Array To Spreadsheet String(array=w21, delimiter=";", format string="%s") -> (spreadsheet string=w22)
          Search And Replace String(input string=w22, replace all (F)=TRUE, replace string ("")="", search string=";") -> (result string=w23)
          $"read buffer" <- w23
          call "Filter Error Code.gvi"(error in=w19, code to clear=1073676294) -> (error out=w8)
          w10 = w6
        }
        frame "Acq. OFF" {
          sequence {
            frame 0 {
              Concatenate Strings("T", "\r") -> w24
              call "Write (Instr, String).gvi"(session in=$"VISA resource name in", error in=w7, write buffer=w24) -> (session out=w25, error out=w26)
            }
            frame 1 {
              call "Clear (Instr).gvi"(session in=w25, error in=w26) -> (session out=w27, error out=w28)
            }
            frame 2 {
              Concatenate Strings("PORTS=1", "\r") -> w29
              call "Write (Instr, String).gvi"(session in=w27, error in=w28, write buffer=w29) -> (session out=w30, error out=w31)
            }
            frame 3 {
              Wait(time to wait=100)
            }
            frame 4 {
              Concatenate Strings("A", "\r") -> w32
              call "Write (Instr, String).gvi"(session in=w30, error in=w31, write buffer=w32) -> (session out=w9, error out=w33)
            }
            frame 5 {
              Wait(time to wait=250)
              Send Notification(error in (no error)=w33, notification="Acq. ON", notifier=w6) -> (error out=w8, notifier out=w10)
            }
          }
        }
      }
      w11 = w3
    }
  }
  $"Current time" <- w12
  $"Play/pause status out" <- w11
  $"VISA Refnum out" <- w9
  $"Acquisition status out" <- w10
  $"error out" <- w8
