vi "Test_data_acquisition.gvi"   [LabVIEW NXG 2.0.0]
panel controls:
  "VISA resource name": "Instr" = "Tracker"
  "Test switch": bool
  "Power Button": bool = TRUE
panel indicators:
  "Current time": timestamp
  "read buffer": string
  "error out": error
diagram:
  call "HW_Setup.gvi"(VISA resource name in=$"VISA resource name") -> (VISA resource name out=w1, Data acquisition status (Acq. OFF)=w2, Play/Pause status (Pause)=w3, Error out=w4)
  while {
    call "Stream_raw_data.gvi"(VISA resource name in=w1, Acquisition status in=w2, Play/pause status is=w3, error in (no error)=w4) -> (VISA Refnum out=w5, Acquisition status out=w6, Play/pause status out=w7, Current time=w8, read buffer=w9, error out=w10)
    $"Current time" <- w8
    $"read buffer" <- w9
    Property Node(instance in=reference to "Power Button") -> ("Value"=w11)
    stop if w11
  }
  call "Stop_acquisition_amd_close_VISA.gvi"(VISA resource name in=w5, Acquisition status in=w6, Play/Pause status in=w7, error in=w10) -> (error out=w12)
  $"error out" <- w12
  while {
    Select(s=$"Test switch", t="Play", f="Pause") -> w13
    Send Notification(notification=w13, notifier=w3)
    stop if $"Power Button"
  }
