vi "Poll_tracker.gvi"   [LabVIEW NXG 2.0.0]
inputs:
  "VISA resource name": "Instr" = "ASRL3::INSTR"
  "error in (no error)": error
outputs:
  "Port data status": i32
  "VISA resource name out": "Instr"
  "Binary mode status": string
  "Coordinate mode status": string
  "Matrix mode status": string
  "FPS status": i32
  "error out": error
  "read buffer": string
panel indicators:
  "Serial Settings:Number of Bytes at Serial Port": u32
  "token index": i32
  "Array of tokens": string[]
  "Binary mode index": i32
  "Coordinate mode index": i32
  "Matrix mode index": i32
  "FPS target index": i32
  "Poll records": u32
  "Port data status index": i32
  "error cleared?": bool  # specific error cleared? indicates whether the error referenced by specific error code to clear has been cleared.
uses:
  NI::VISA::Write (Instr, String).gvi
  NI::VISA::Read (Instr, String).gvi
  NI::G Core::Error::Filter Error Code.gvi
  NI::G Core::Error::Multiplex Errors.gvi
  NI::G Core::Strings::Trim Whitespace.gvi
diagram:
  Concatenate Strings("P", "\r") -> w1
  call "Write (Instr, String).gvi"(session in=$"VISA resource name", error in=$"error in (no error)", write buffer=w1) -> (session out=w2, error out=w3, return count=w4)
  sequence {
    frame 0 {
      Wait(time to wait=100)
    }
  }
  Property Node(instance in=w2, error in=w3) -> ("ASRL Bytes at Port"=w5, error out=w6, instance out=w7)
  call "Read (Instr, String).gvi"(session in=w7, error in=w6, byte count=w5) -> (session out=w8, error out=w9, read buffer=w10)
  call "Filter Error Code.gvi"(error in=w9, code to clear=1073676294) -> (error out=w11, error cleared?=w12)
  $"error cleared?" <- w12
  while {
    w14 = ["I am alive", "Binary mode", "Coordinate mode", "Matrix mode", "FPS target", "External USART status", "LED status", "Port data status", "IOS"]
    Feedback Node(initial value=0, input=w15) -> w16
    Scan String For Tokens(allow empty tokens=FALSE, delimiters=["\\r", "\\n", "\\s", "\\r\\n", ",", ":", " ", "="], input string=w10, offset=w16, operators=w14, use cache=FALSE) -> (offset past token=w15, token index=w17, token string=w18)
    Is Equal(x=w17, y=-2) -> w19
    $"token index" <- w17
    append w18 to w13
    stop if w19
  }
  Search 1D Array(1D array=w13, element="Port data status") -> (index of element=w20)
  $"Port data status index" <- w20
  $"VISA resource name out" <- w8
  Search 1D Array(1D array=w13, element="Matrix mode") -> (index of element=w21)
  $"Matrix mode index" <- w21
  Increment(x=w20) -> w22
  Array Index(array=w13) -> (out0[w22]=w23)
  String Length(string=w23) -> (length=w24)
  Subtract(x=w24, y=2) -> w25
  String Subset(length (rest)=w25, offset (0)=0, string=w23) -> w26
  Decimal String To Number(string=w26) -> (number=w27)
  $"Port data status" <- w27
  Search 1D Array(1D array=w13, element="Binary mode") -> (index of element=w28)
  $"Binary mode index" <- w28
  $"Poll records" <- w4
  $"read buffer" <- w10
  Add(w21, 1) -> w29
  Array Index(array=w13) -> (out0[w29]=w30)
  String Length(string=w30) -> (length=w31)
  Subtract(x=w31, y=2) -> w32
  String Subset(length (rest)=w32, offset (0)=0, string=w30) -> w33
  $"Matrix mode status" <- w33
  $"Array of tokens" <- w13
  Search 1D Array(1D array=w13, element="FPS target") -> (index of element=w34)
  $"FPS target index" <- w34
  Add(w28, 1) -> w35
  Array Index(array=w13) -> (out0[w35]=w36)
  String Length(string=w36) -> (length=w37)
  Subtract(x=w37, y=2) -> w38
  String Subset(length (rest)=w38, offset (0)=0, string=w36) -> w39
  $"Binary mode status" <- w39
  Add(w34, 1) -> w40
  Array Index(array=w13) -> (out0[w40]=w41)
  String Length(string=w41) -> (length=w42)
  Subtract(x=w42, y=2) -> w43
  String Subset(length (rest)=w43, offset (0)=0, string=w41) -> w44
  Decimal String To Number(string=w44) -> (number=w45)
  $"FPS status" <- w45
  Search 1D Array(1D array=w13, element="Coordinate mode") -> (index of element=w46)
  $"Coordinate mode index" <- w46
  Add(w46, 1) -> w47
  Array Index(array=w13) -> (out0[w47]=w48)
  String Length(string=w48) -> (length=w49)
  Subtract(x=w49, y=2) -> w50
  String Subset(length (rest)=w50, offset (0)=0, string=w48) -> w51
  $"Coordinate mode status" <- w51
  $"Serial Settings:Number of Bytes at Serial Port" <- w5
  w52 = error {"status"=TRUE, "code"=404, "source"="Instrument is not connected!"}
  call "Multiplex Errors.gvi"(error in 1=w52, error in 2=w11) -> (error out=w53)
  Search 1D Array(1D array=w13, element="I am alive") -> (index of element=w54)
  Add(w54, 2) -> w55
  Array Index(array=w13) -> (out0[w55]=w56)
  call "Trim Whitespace.gvi"(string=w56) -> (trimmed string=w57)
  Is Equal(x=w57, y="OK!") -> w58
  Select(s=w58, t=w11, f=w53) -> w59
  $"error out" <- w59
