vi "Stream_data.gvi"   [LabVIEW NXG 2.0.0]
inputs:
  "Acquisition status in": Notifier<string>
  "VISA resource name in": "Instr"
  "Play / Pause": bool
  "Read TTL status in": bool
  "error in (no error)": error
outputs:
  "Acquisition status out": Notifier<string>
  "error out": error
  "notifier name": string
  "VISA Refnum out": "Instr"
  "Read TTL status out": bool
  "Current time": timestamp
  "read buffer": string
uses:
  NI::VISA::Write (Instr, String).gvi
  NI::VISA::Flush Buffer (Instr).gvi
  NI::VISA::Read (Instr, Bytes).gvi
  NI::G Core::Error::Filter Error Code.gvi
  NI::VISA::Clear (Instr).gvi
diagram:
  Get Notifier Status(error in (no error)=$"error in (no error)", notifier=$"Acquisition status in") -> (error out=w1, latest notification=w2, notifier name=w3, notifier out=w4)
  case ($"Play / Pause") {
    frame False, Default {
      case (w2) {
        frame "Acq. OFF", Default {
          w5 = w1
          w6 = $"VISA resource name in"
          w7 = w4
        }
        frame "Acq. ON" {
          sequence {
            frame 0 {
              call "Write (Instr, String).gvi"(session in=$"VISA resource name in", error in=w1, write buffer="T") -> (session out=w9, error out=w10)
            }
            frame 1 {
              Wait(time to wait=100)
              Send Notification(error in (no error)=w10, notification="Acq. OFF", notifier=w4) -> (error out=w11, notifier out=w7)
            }
            frame 2 {
              call "Flush Buffer (Instr).gvi"(session in=w9, error in=w11, mode="Discard Receive Buffer"(64)) -> (session out=w6, error out=w5)
            }
          }
        }
      }
      w8 = $"Read TTL status in"
    }
    frame True {
      case (w2) {
        frame "Acq. ON", Default {
          Wait(time to wait=25)
          Get Current Time() -> (current time=w12)
          $"Current time" <- w12
          Property Node(instance in=$"VISA resource name in", error in=w1) -> ("ASRL Bytes at Port"=w13, error out=w14, instance out=w15)
          call "Read (Instr, Bytes).gvi"(session in=w15, error in=w14, byte count=w13) -> (session out=w6, error out=w16, read buffer=w17)
          Number To Hexadecimal String(number=w17, width (-)=2) -> (hex integer string=w18)
          Array To Spreadsheet String(array=w18, delimiter=";", format string="%s") -> (spreadsheet string=w19)
          Search And Replace String(input string=w19, replace all (F)=TRUE, replace string ("")="", search string=";") -> (result string=w20)
          $"read buffer" <- w20
          call "Filter Error Code.gvi"(error in=w16, code to clear=1073676294) -> (error out=w5)
          w7 = w4
          w8 = $"Read TTL status in"
        }
        frame "Acq. OFF" {
          sequence {
            frame 0 {
              Concatenate Strings("T", "\r") -> w21
              call "Write (Instr, String).gvi"(session in=$"VISA resource name in", error in=w1, write buffer=w21) -> (session out=w22, error out=w23)
            }
            frame 1 {
              call "Clear (Instr).gvi"(session in=w22, error in=w23) -> (session out=w24, error out=w25)
            }
            frame 2 {
              Select(s=$"Read TTL status in", t="PORTS=1", f="PORTS=0") -> w26
              Concatenate Strings(w26, "\r") -> w27
              call "Write (Instr, String).gvi"(session in=w24, error in=w25, write buffer=w27) -> (session out=w28, error out=w29)
            }
            frame 3 {
              Wait(time to wait=100)
            }
            frame 4 {
              Concatenate Strings("A", "\r") -> w30
              call "Write (Instr, String).gvi"(session in=w28, error in=w29, write buffer=w30) -> (session out=w6, error out=w31)
            }
            frame 5 {
              Wait(time to wait=250)
              Send Notification(error in (no error)=w31, notification="Acq. ON", notifier=w4) -> (error out=w5, notifier out=w7)
            }
          }
          w8 = $"Read TTL status in"
        }
      }
    }
  }
  $"Acquisition status out" <- w7
  $"notifier name" <- w3
  $"VISA Refnum out" <- w6
  $"error out" <- w5
  $"Read TTL status out" <- w8
