vi "Test_data_acquisition.gvi"   [LabVIEW NXG 2.0.0]
panel controls:
  "VISA resource name": "Instr" = "Tracker"
  "stop": bool
panel indicators:
  "Current time": timestamp
  "read buffer": string
  "error out": error
diagram:
  call "Tracker_hardware_initialize.gvi"(VISA resource name=$"VISA resource name") -> (VISA resource name out=w1, error out=w2)
  Obtain Notifier(element data type=string "", error in=w2, name="Data acquisition status") -> (error out=w3, notifier out=w4)
  Send Notification(error in (no error)=w3, notification="Acq. OFF", notifier=w4) -> (error out=w5, notifier out=w6)
  while {
    call "Stream_data.gvi"(VISA resource name in=w1, Acquisition status in=w6, Play / Pause=TRUE, error in (no error)=w5) -> (VISA Refnum out=w7, Acquisition status out=w8, Current time=w9, read buffer=w10, error out=w11)
    $"Current time" <- w9
    $"read buffer" <- w10
    stop if $stop
  }
  call "Stop_acquisition_amd_close_VISA.gvi"(VISA resource name in=w7, Acquisition status in=w8, error in=w11) -> (error out=w12)
  $"error out" <- w12
