vi "Tracker_hardware_initialize.gvi"   [LabVIEW NXG 2.0.0]
inputs:
  "Target FPS": i32 = 80
  "VISA resource name": "Instr" = "Tracker"
  "Close port? (T)": bool
  "error in": error
outputs:
  "Hardware init OK?": Notifier<string>
  "error out": error
  "VISA resource name out": "Instr"
panel indicators:
  "Binary mode status": string
  "Coordinate mode status": string
  "Matrix mode status": string
  "FPS status": i32
  "Poll FPS": u32
  "Poll Coord": u32
  "Poll Matrix": u32
  "Poll Binary": u32
  "read buffer": string
  "Port data status": i32
  "Poll Port data status": u32
uses:
  NI::VISA::Configure Serial Port (Instr).gvi
  NI::VISA::Open (Instr).gvi
  NI::VISA::Clear (Instr).gvi
  NI::VISA::Set Buffer Size (Instr).gvi
  NI::VISA::Write (Instr, String).gvi
  NI::VISA::Close (Instr).gvi
  NI::G Core::Error::Is Error.gvi
diagram:
  call "Configure Serial Port (Instr).gvi"(flow control="RTS/CTS"(2), session in=$"VISA resource name", error in=$"error in", baud rate=256000, timeout=2000, enable termination char=FALSE) -> (session out=w1, error out=w2)
  Property Node(instance in=w2) -> ("status"=w3)  # Error Properties
  case (w3) {
    frame False, Default {
      sequence {
        frame 0 {
          Wait(time to wait=200)
        }
        frame 1 {
          call "Open (Instr).gvi"(resource name=w1, error in=w2, open timeout=100) -> (session out=w6, error out=w7)
        }
        frame 2 {
          call "Clear (Instr).gvi"(session in=w6, error in=w7) -> (session out=w8, error out=w9)
        }
        frame 3 {
          call "Set Buffer Size (Instr).gvi"(session in=w8, error in=w9, buffer="Receive Buffer"(16), size=2048) -> (session out=w10, error out=w11)
        }
        frame 4 {
          call "Set Buffer Size (Instr).gvi"(session in=w10, error in=w11, buffer="Transmit Buffer"(32), size=16) -> (session out=w12, error out=w13)
        }
        frame 5 {
          call "Poll_tracker.gvi"(VISA resource name=w12, error in (no error)=w13) -> (error out=w14, VISA resource name out=w15, Binary mode status=w16, Coordinate mode status=w17, Matrix mode status=w18, FPS status=w19, Port data status=w20, read buffer=w21)
          $"read buffer" <- w21
          $"Binary mode status" <- w16
          $"Coordinate mode status" <- w17
          $"Matrix mode status" <- w18
          $"FPS status" <- w19
          $"Port data status" <- w20
        }
        frame 6 {
          Is Not Equal(x=w19, y=$"Target FPS") -> w22
          case (w22) {
            frame False, Default {
              w23 = w14
              w24 = w15
            }
            frame True {
              Number To Decimal String(number=$"Target FPS") -> (decimal integer string=w25)
              Concatenate Strings("FPS=", w25, "\r") -> w26
              call "Write (Instr, String).gvi"(session in=w15, error in=w14, write buffer=w26) -> (session out=w24, error out=w23, return count=w27)
              $"Poll FPS" <- w27
            }
          }
        }
        frame 7 {
          Wait(time to wait=100)
        }
        frame 8 {
          Is Not Equal(x=w20, y=0) -> w28
          case (w28) {
            frame False, Default {
              w29 = w23
              w30 = w24
            }
            frame True {
              Concatenate Strings("PORTS=0", "\r") -> w31
              call "Write (Instr, String).gvi"(session in=w24, error in=w23, write buffer=w31) -> (session out=w30, error out=w29, return count=w32)
              $"Poll Port data status" <- w32
            }
          }
        }
        frame 9 {
          Wait(time to wait=100)
        }
        frame 10 {
          Is Equal(x="OFF", y=w17) -> w33
          case (w33) {
            frame False, Default {
              w34 = w30
              w35 = w29
            }
            frame True {
              Concatenate Strings("C", "\r") -> w36
              call "Write (Instr, String).gvi"(session in=w30, error in=w29, write buffer=w36) -> (session out=w34, error out=w35, return count=w37)
              $"Poll Coord" <- w37
            }
          }
        }
        frame 11 {
          Wait(time to wait=100)
        }
        frame 12 {
          Is Equal(x="ON", y=w18) -> w38
          case (w38) {
            frame False, Default {
              w39 = w34
              w40 = w35
            }
            frame True {
              Concatenate Strings("L", "\r") -> w41
              call "Write (Instr, String).gvi"(session in=w34, error in=w35, write buffer=w41) -> (session out=w39, error out=w40, return count=w42)
              $"Poll Matrix" <- w42
            }
          }
        }
        frame 13 {
          Wait(time to wait=100)
        }
        frame 14 {
          Is Equal(x="OFF", y=w16) -> w43
          case (w43) {
            frame False, Default {
              w5 = w39
              w44 = w40
            }
            frame True {
              Concatenate Strings("B", "\r") -> w45
              call "Write (Instr, String).gvi"(session in=w39, error in=w40, write buffer=w45) -> (session out=w5, error out=w44, return count=w46)
              $"Poll Binary" <- w46
            }
          }
        }
        frame 15 {
          Wait(time to wait=100)
        }
        frame 16 {
          case ($"Close port? (T)") {
            frame False, Default {
              w4 = w44
            }
            frame True {
              call "Close (Instr).gvi"(session in=w5, error in=w44) -> (error out=w4)
            }
          }
        }
      }
    }
    frame True {
      w4 = w2
      w5 = w1
    }
  }
  $"VISA resource name out" <- w5
  Obtain Notifier(element data type=string "", error in=w4, name="INIT") -> (error out=w47, notifier out=w48)
  call "Is Error.gvi"(error in=w4) -> (error?=w49)
  Select(s=w49, t="INIT FAIL", f="INIT OK") -> w50
  Send Notification(error in (no error)=w47, notification=w50, notifier=w48) -> (error out=w51, notifier out=w52)
  $"error out" <- w51
  $"Hardware init OK?" <- w52
